# Grasshopper definition mac_csparse_test.gh (Grasshopper 1.0.7)
# plug-ins: Test

number_slider = Slider(1, range=0..1)
number_slider_2 = Slider(1000, range=0..1000)
info = Info(Nodenum=Slider(10000, range=0..10000))
panel = Panel(info)
