# Grasshopper definition test.gh (Grasshopper 1.0.7)
# plug-ins: StructuralToolbox, karambaGH

mat = Material(Tag="S355", E="210000", G="81000", Gamma="78.5", Alpha="12e-6", Fy="355")
mat_2 = Material(mat)
point = Point(Point(0, 0, 0))
line_sdl = LineSDL(Start=point, Direction=Vector(0, 0, 1), Length=Slider(10, range=0..10000))
rad = Radians(Degrees=Slider(90, range=0..90))
rad_2 = Radians(Degrees=Slider(90, range=0..90))
panel = Panel("78.5")
panel_2 = Panel("12e-6")
panel_3 = Panel("S355")
panel_4 = Panel("355")
number_slider = Slider(4, range=1..10)
sec_r = Sec_Rect(Material=mat_2, Tag="150x300", Width="150", Height="300", Theta=Slider(30, range=0..100))
sec_i = Sec_I(Material=mat_2, Tag="IPE300", Height="300", Width="150", TWeb="7.1", TFlange="10.7", Theta=rad)
sec_rhs = Sec_RHS(Material=mat_2, Tag="RHS300", Height="300", Width="150", TWeb="7.1", TFlange="10.7", Theta=rad_2)
sec_chs = Sec_CHS(Material=mat_2, Tag="CHS300", Diameter="300", Thickness="15")
sec_circ = Sec_Circ(Material=mat_2, Tag="100", Diameter="100")
crv = Curve(line_sdl)
sec = Section(sec_chs)
sec_2 = Section(sec_r)
sec_3 = Section(sec_circ)
sec_4 = Section(sec_i)
sec_5 = Section(sec_rhs)
division = Division(A="210000", B=10)
division_2 = Division(A="81000", B=10)
divide = DivideCurve(Curve=crv, Count=Slider(10, range=1..1000), Kinks=False)  # -> Points, Tangents, Parameters
info_sec = Info_Section(Section=sec_4)  # -> Material, Tag, Dimensions, Theta, StructuralProps
panel_5 = Panel(sec_2)
panel_6 = Panel(sec_3)
panel_7 = Panel(sec_4)
panel_8 = Panel(sec_5)
panel_9 = Panel(sec)
shatter = Shatter(Curve=simplify(graft(crv)), Parameters=simplify(divide.Parameters))  # -> simplify(flatten(Segments))
join = JoinCurves(Curves=crv, Preserve=False)
matprops = MaterialPropertiesKaramba3D(
    FamilyOfMaterial="Steel",
    Name="S235",
    YoungsModulus_kN_cm2=division,
    InPlaneShearModulus_kN_cm2=division_2,
    TransverseShearModulus_kN_cm2=division_2,
    SpecificWeight_kN_m3=78.5,
    CoefficientOfThermalExpansion_1_C=1e-05,
    YieldStrength_kN_cm2=23.5,
    mode="Isotrop")
end = EndPoints(Curve=join)  # -> Start, End
panel_10 = Panel(info_sec.StructuralProps)
info_mat = Info_Material(Material=info_sec.Material)  # -> Tag, E, G, Gamma, Alpha, Fy
merge = Merge(Data1=info_sec.Material, Data2=info_sec.Tag, Data3=info_sec.Dimensions, Data4=info_sec.Theta)
number_slider_2 = Slider(10, range=0..10)
elem1d = Element_1D(Lines=shatter, Section=sec_4, Tag="E1")
merge_2 = Merge(Data1=info_mat.Tag, Data2=info_mat.E, Data3=info_mat.G, Data4=info_mat.Gamma, Data5=info_mat.Alpha, Data6=info_mat.Fy)
panel_11 = Panel(merge_2)
division_3 = Division(A="300", B=10)
division_4 = Division(A="150", B=10)
division_5 = Division(A="10.7", B=10)
division_6 = Division(A="7.1", B=10)
elem1d_2 = Element_1D(elem1d)
Y = UnitY(Factor=number_slider_2)
X = UnitX(Factor=number_slider_2)
cross_section = CrossSectionKaramba3D(
    FamilyNameOfCrossSection="DefaultCroSec",
    Material=matprops,
    Height_cm=division_3,
    UpperFlangeWidth_cm=division_4,
    LowerFlangeWidth_cm=division_4,
    UpperFlangeThickness_cm=division_5,
    LowerFlangeThickness_cm=division_5,
    WebThickness_cm=division_6,
    FilletRadius_cm=0,
    mode="I")
panel_12 = Panel(merge)
pt_load = PointLoad(Point=end.End, ForceVector=Y, MomentVector=Vector(0, 0, 0), LoadCase=0)
pt_load_2 = PointLoad(Point=end.End, ForceVector=X, MomentVector=Vector(0, 0, 0), LoadCase="1")
sup = Support(Points=end.Start, Conditions="111111")
sup_2 = Support(sup)
load = Load([pt_load, pt_load_2])
Y_2 = UnitY(Factor=1)
Z = UnitZ(Factor=1)
X_2 = UnitX(Factor=1)
vrot = Rotate(Vector=Y_2, Axis=Z, Angle=rad)
assembly = Assembly(Element_1Ds=elem1d_2, Supports=sup_2, Loads=flatten(load))
info_sup = Info_Support(Support=sup_2)  # -> Points, Conditions
supp = SupportKaramba3D(PosInd=end.Start, menu=[buttons(on, on, on, on, on, on)])
loads = LoadsKaramba3D(ForceVector=Y, Local=False, PosInd=end.End, LCase=0, mode="Point")
linetobeam = LineToBeamKaramba3D(Line=shatter, CrossSection=cross_section, New=True, Remove=Toggle(False), LimitDistance_m=0.005, ZOrientation=vrot)  # -> Element, Points, Info
loads_2 = LoadsKaramba3D(ForceVector=X, Local=False, PosInd=end.End, LCase="1", mode="Point")
model = Model(assembly)
number_slider_3 = Slider(1, range=0..1)
number_slider_4 = Slider(3, range=1..50)
solve_ls = SolveLinearStatic(Model=model)
assemble = AssembleModelKaramba3D(Elem=linetobeam.Element, Support=supp, Load=flatten([loads, loads_2]), LimitDistance_m=0.005)  # -> Model, Info, Mass_kg, CenterOfGravity
info_model = Info_Model(Model=solve_ls)  # -> Points, Lines, Nodes, Element_1Ds, Supports, Loads
deform = Deformed_Shape(Model=solve_ls, LoadCase=number_slider_3, Factor=number_slider_4)  # -> Points, Lines
number_slider_5 = Slider(1, range=0..1)
analyze = AnalyzeKaramba3D(Model=assemble.Model)  # -> CalculatedModel, MaximumDisplacement_cm, ResultingForceOfGravity_kN, ElasticEnergy_kNm
info_elem1d = Info_Element_1D(Element_1D=info_model.Element_1Ds)  # -> Lines, Nodes, Sections, Tags, IDs
info_sup_2 = Info_Support(Support=info_model.Supports)  # -> Points, Conditions
info_pload = Info_PointLoad(Load=info_model.Loads)  # -> Points, ForceVector, MomentVector, LoadCase
nodedisp = NodalDisplacementsKaramba3D(AnalyzedModel=analyze.CalculatedModel, ResultCase=0)  # -> AnalyzedModel, NodalTranslations_m, NodalRotations_rad
modelview = ModelViewKaramba3D(Model=analyze.CalculatedModel, ResultFactors=number_slider_4, ResultCase=number_slider_3)  # -> Model, DeformedMesh, DeformedAxes, DeformedModel
info_sec_2 = Info_Section(Section=info_elem1d.Sections)  # -> Material, Tag, Dimensions, Theta, StructuralProps
panel_13 = Panel(info_model.Nodes)
info_node = Info_Node(Node=info_elem1d.Nodes)  # -> Points, Id
panel_14 = Panel(nodedisp.NodalTranslations_m)
info_mat_2 = Info_Material(Material=info_sec_2.Material)  # -> Tag, E, G, Gamma, Alpha, Fy
crv_2 = Curve(modelview.DeformedAxes)
disassemble = DisassembleModelKaramba3D(Model=modelview.DeformedModel)  # -> Model, Point, Beam, Shell, Support, Load, Line, Mesh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
pt = Point(disassemble.Point)
