# Grasshopper definition test1.gh (Grasshopper 1.0.7)
# plug-ins: StructuralToolbox, Bifocals, karambaGH

columns = Line([Line((6, 0, 4), (6, 0, 0)), Line((0, 0, 4), (0, 0, 0)), Line((0, 6, 4), (0, 6, 0)), Line((6, 6, 4), (6, 6, 0))])
beams = Line([Line((0, 0, 4), (6, 0, 4)), Line((0, 6, 4), (6, 6, 4)), Line((6, 0, 4), (6, 6, 4)), Line((0, 0, 4), (0, 6, 4))])
number_slider = Slider(4, range=1..10)
mat = Material(Tag="S355", E="210000", G="81000", Gamma="78.5", Alpha="12e-6", Fy="355")
divide = DivideCurve(Curve=columns, Count=number_slider, Kinks=False)  # -> Points, Tangents, Parameters
divide_2 = DivideCurve(Curve=beams, Count=number_slider, Kinks=False)  # -> Points, Tangents, Parameters
mat_2 = Material(mat)
shatter = Shatter(Curve=simplify(graft(beams)), Parameters=simplify(divide_2.Parameters))  # -> flatten(Segments)
shatter_2 = Shatter(Curve=simplify(graft(columns)), Parameters=simplify(divide.Parameters))  # -> flatten(Segments)
line = Line([Line((0, 0, 4), (6, 0, 4)), Line((0, 6, 4), (6, 6, 4)), Line((6, 0, 4), (6, 6, 4)), Line((0, 0, 4), (0, 6, 4))])
mat_3 = Material(Tag="S355", E="210000", G="81000", Gamma="78.5", Alpha="12e-6", Fy="355")
end = EndPoints(Curve=columns)  # -> Start, End
pt = Point(end.Start)
number_slider_2 = Slider(4, range=1..10)
number_slider_3 = Slider(100, range=0..1000)
sec_chs = Sec_CHS(Material=mat_2, Tag="CHS300", Diameter="300", Thickness="15")  # -> Section, Curves
sec_r = Sec_Rect(Material=mat_2, Tag="150x300", Width="150", Height="300")  # -> Section, Curves
sec_circ = Sec_Circ(Material=mat_2, Tag="300", Diameter="300")  # -> Section, Curves
sec_i = Sec_I(Material=mat_2, Tag="IPE300", Height="300", Width="150", TWeb="7.1", TFlange="10.7")  # -> Section, Curves
sec_rhs = Sec_RHS(Material=mat_2, Tag="RHS300", Height="300", Width="150", TWeb="7.1", TFlange="10.7")  # -> Section, Curves
sec_i_2 = Sec_I(Material=mat_3, Tag="IPE300", Height="300", Width="150", TWeb="7.1", TFlange="10.7")  # -> Section, Curves
sec_chs_2 = Sec_CHS(Material=mat_3, Tag="CHS300", Diameter="300", Thickness="15")  # -> Section, Curves
beams_2 = Curve([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])
columns_2 = Curve([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])
sec = Section(sec_r.Section)
sec_2 = Section(sec_circ.Section)
pt_2 = Point([Point(0, 6, 4), Point(0, 0, 4)])
sec_3 = Section(sec_chs.Section)
sec_4 = Section(sec_3)
sec_5 = Section(sec_rhs.Section)
sec_6 = Section(sec_i.Section)
info_sec = Info_Section(Section=sec_chs_2.Section)  # -> Material, Tag, Dimensions, Theta, StructuralProps, Curves
pt_load = PointLoad(Point=pt, ForceVector="{0,10,0}", MomentVector=Vector(0, 0, 0), LoadCase="1")
sup = Support(Points=end.End, Conditions="111111")
elem1d = Element_1D(Lines=shatter, Section=sec_i_2.Section, Tag="B1")
elem1d_2 = Element_1D(Lines=shatter_2, Section=sec_chs_2.Section, Tag="C1")
pt_load_2 = PointLoad(Point=pt, ForceVector="{10,0,0}", MomentVector=Vector(0, 0, 0), LoadCase="0")
divide_3 = DivideCurve(Curve=beams_2, Count=number_slider_2, Kinks=False)  # -> Points, Tangents, Parameters
divide_4 = DivideCurve(Curve=columns_2, Count=number_slider_2, Kinks=False)  # -> Points, Tangents, Parameters
item = ListItem(List=reverse(pt_2), Index=0, Wrap=True)
info_sec_2 = Info_Section(Section=sec_6)  # -> Material, Tag, Dimensions, Theta, StructuralProps, Curves
panel = Panel(info_sec.StructuralProps)
panel_2 = Panel(sec_3)
pt_3 = Point([Point(6, 0, 0), Point(6, 6, 0), Point(0, 0, 0), Point(0, 6, 0)])
panel_3 = Panel(sec)
panel_4 = Panel(sec_2)
panel_5 = Panel(sec_6)
panel_6 = Panel(sec_5)
shatter_3 = Shatter(Curve=simplify(graft(beams_2)), Parameters=divide_3.Parameters)  # -> simplify(flatten(Segments))
pt_4 = Point(item)
shatter_4 = Shatter(Curve=simplify(graft(columns_2)), Parameters=divide_4.Parameters)  # -> simplify(flatten(Segments))
panel_7 = Panel("78.5")
panel_8 = Panel("12e-6")
merge = Merge(Data1=pt_load_2, Data2=pt_load)
panel_9 = Panel("S355")
merge_2 = Merge(Data1=elem1d, Data2=elem1d_2)  # -> flatten(Result)
panel_10 = Panel("355")
sec_7 = Section(sec_5)
panel_11 = Panel("{1,1,0}")
panel_12 = Panel(info_sec_2.StructuralProps)
info_mat = Info_Material(Material=info_sec_2.Material)  # -> Tag, E, G, Gamma, Alpha, Fy
merge_3 = Merge(Data1=info_sec_2.Material, Data2=info_sec_2.Tag, Data3=info_sec_2.Dimensions, Data4=info_sec_2.Theta)
panel_13 = Panel("{1,1,1}")
assembly = Assembly(Element_1Ds=merge_2, Supports=sup, Loads=merge)  # -> Model, Weight
number_slider_4 = Slider(10, range=0..10)
number_slider_5 = Slider(100, range=0..100)
elem1d_3 = Element_1D(Lines=shatter_3, Section=sec_6, Tag="B1")
elem1d_4 = Element_1D(Lines=shatter_4, Section=sec_3, Tag="C1")
merge_4 = Merge(Data1=info_mat.Tag, Data2=info_mat.E, Data3=info_mat.G, Data4=info_mat.Gamma, Data5=info_mat.Alpha, Data6=info_mat.Fy)
division = Division(A="210000", B=10)
division_2 = Division(A="81000", B=10)
solve_ls = SolveLinearStatic(Model=assembly.Model)
panel_14 = Panel(merge_4)
matprops = MaterialPropertiesKaramba3D(
    FamilyOfMaterial="Steel",
    Name="S235",
    YoungsModulus_kN_cm2=division,
    InPlaneShearModulus_kN_cm2=division_2,
    TransverseShearModulus_kN_cm2=division_2,
    SpecificWeight_kN_m3=78.5,
    CoefficientOfThermalExpansion_1_C=1e-05,
    YieldStrength_kN_cm2=23.5,
    mode="Isotrop")
hinge = Hinge(Element_1D=elem1d_3, StartMy=Toggle(True), StartMz=Toggle(True), EndMy=Toggle(True), EndMz=Toggle(True))
elem1d_5 = Element_1D(flatten([elem1d_4, hinge]))
Y = UnitY(Factor=number_slider_5)
X = UnitX(Factor=number_slider_5)
item_2 = ListItem(List=pt_3, Index=0, Wrap=True)  # -> Item, Item1, Item2, Item3
panel_15 = Panel(merge_3)
sup_2 = Support(Points=[item_2.Item2, item_2.Item3], Conditions="111111")
pt_load_3 = PointLoad(Point=pt_4, ForceVector=Y, MomentVector=Vector(0, 0, 0), LoadCase=0)
pt_load_4 = PointLoad(Point=pt_4, ForceVector=X, MomentVector=Vector(0, 0, 0), LoadCase="1")
info_model = Info_Model(Model=solve_ls)  # -> Points, Lines, Nodes, Element_1Ds, Supports, Loads
deform = Deformed_Shape(Model=solve_ls, LoadCase="0", Factor=Slider(200, range=0..1000))  # -> DefModel, Disp, Rotation, Points, Lines
reaction = Reaction(Model=solve_ls, LoadCases="0")  # -> Support, Points, FX, FY, FZ, MX, MY, MZ
e1d_forces = Elem1D_Forces(Model=solve_ls, ElementTags="C1", LoadCases="0")  # -> Elements, N, Vy, Vz, Mx, My, Mz
number_slider_6 = Slider(1000, range=0..1000)
number_slider_7 = Slider(1000, range=0..10000)
sup_3 = Support(Points=[item_2.Item, item_2.Item1], Conditions="011000")
sup_4 = Support(flatten([sup_2, sup_3]))
load = Load([pt_load_3, pt_load_4])
division_3 = Division(A="300", B=10)
division_4 = Division(A="10.7", B=10)
division_5 = Division(A="7.1", B=10)
division_6 = Division(A="150", B=10)
merge_5 = Merge(Data1=reaction.FX, Data2=reaction.FY, Data3=reaction.FZ, Data4=reaction.MX, Data5=reaction.MY, Data6=reaction.MZ)
division_7 = Division(A="300", B=10)
assembly_2 = Assembly(Element_1Ds=elem1d_5, Supports=sup_4, Loads=flatten(load))  # -> Model, Weight
division_8 = Division(A="15", B=10)
draw_cs = Draw_CrossSection(Model=deform.DefModel)  # -> Elem, Mesh
panel_16 = Panel(e1d_forces.N)
columns_3 = Curve([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])
info_sup = Info_Support(Support=sup_4)  # -> Points, Conditions
mat_4 = Material(mat_2)
panel_17 = Panel(merge_5)
number_slider_8 = Slider(100, range=0..100)
cross_section = CrossSectionKaramba3D(
    FamilyNameOfCrossSection="DefaultCroSec",
    Material=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,
    Diameter_cm=division_7,
    WallThickness_cm=division_8,
    mode="Circular Hollow")
cross_section_2 = CrossSectionKaramba3D(
    FamilyNameOfCrossSection="DefaultCroSec",
    Material=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,
    Height_cm=division_6,
    UpperFlangeWidth_cm=division_3,
    LowerFlangeWidth_cm=division_3,
    UpperFlangeThickness_cm=division_5,
    LowerFlangeThickness_cm=division_5,
    SidewallsThickness_cm=division_4,
    FilletRadius_cm=0.6,
    mode="Box")
item_3 = ListItem(List=columns_3, Index=0, Wrap=True)
divide_5 = DivideCurve(Curve=item_3, Count=Slider(3, range=1..10), Kinks=False)  # -> Points, Tangents, Parameters
shatter_5 = Shatter(Curve=item_3, Parameters=divide_5.Parameters)
solve_ls_2 = SolveLinearStatic(Model=assembly_2.Model)
Y_2 = UnitY(Factor=1)
sec_r_2 = Sec_Rect(Material=mat_4, Tag="S1", Width="120", Height="240")  # -> Section, Curves
X_2 = UnitX(Factor=1)
flip = FlipMatrix(Data=panel_17)
python = GhPythonScript(x=solve_ls_2)  # -> out, a
# ---------- python: Python ----------
__author__ = "bunjii"
__version__ = "2021.04.02"

import rhinoscriptsyntax as rs

print(x.SelectedLC)
# ---------- end python ----------
end_2 = EndPoints(Curve=item_3)  # -> Start, End
panel_18 = Panel("C1")
number_slider_9 = Slider(1, range=0..1)
panel_19 = Panel(number_slider_9)
panel_20 = Panel("1")
Z = UnitZ(Factor=number_slider_8)
neg = Negative(Value=Z)
Y_3 = UnitY(Factor=number_slider_8)
number_slider_10 = Slider(1, range=1..50)
X_3 = UnitX(Factor=Slider(100, range=0..100))
e1d_forces_2 = Elem1D_Forces(Model=solve_ls_2, ElementTags="C1", LoadCases=panel_19)  # -> Elements, N, Vy, Vz, Mx, My, Mz
addition = Addition(A=X_2, B=Y_2)  # disabled
panel_21 = Panel("B1")
panel_22 = Panel(flip)
panel_23 = Panel(python.out)
sup_5 = Support(Points=end_2.End, Conditions="111111")
toggle = BooleanToggle(False)
pt_load_5 = PointLoad(Point=end_2.Start, ForceVector=Z, MomentVector=Vector(0, 0, 0), LoadCase=0)
elem1d_6 = Element_1D(Lines=shatter_5, Section=sec_r_2.Section, Tag="E1", ZDir=addition)
draw_cs_2 = Draw_CrossSection(Model=solve_ls_2)  # -> Elem, Mesh
model = Model(solve_ls_2)
panel_24 = Panel(e1d_forces_2.N)

# ---- group: Info components
info_model_2 = Info_Model()  # -> Points, Lines, Nodes, Element_1Ds, Supports, Loads
info_elem1d = Info_Element_1D()  # -> Lines, Nodes, Sections, BetaAngle, Plane, Tags, IDs
info_mat_2 = Info_Material()  # -> Tag, E, G, Gamma, Alpha, Fy
info_sec_3 = Info_Section()  # -> Material, Tag, Dimensions, Theta, StructuralProps, Curves
info_sup_2 = Info_Support()  # -> Points, Conditions
info_node = Info_Node()  # -> Points, Id
info_pload = Info_PointLoad()  # -> Points, ForceVector, MomentVector, LoadCase

# ----
deform_2 = Deformed_Shape(Model=solve_ls_2, LoadCase=number_slider_9, Factor=number_slider_10)  # -> DefModel, Points, Lines, Points_2, Lines_2
draw_cs_3 = Draw_CrossSection(Model=deform_2.DefModel)  # -> Elem, Mesh
supp = SupportKaramba3D(PosInd=pt_3, menu=[buttons(on, on, on, on, on, on)])
ma = MassAddition(Input=panel_22)  # -> Result, PartialResults
pt_load_6 = PointLoad(Point=end_2.Start, ForceVector=X_3, MomentVector=Vector(0, 0, 0), LoadCase="1")

# ---- group: Loads (Karamba3D)
loads = LoadsKaramba3D(ForceVector=Y, Local=False, PosInd=pt_4, LCase=0, mode="Point")

# ----
info_model_3 = Info_Model(Model=solve_ls_2)  # -> Points, Lines, Nodes, Element_1Ds, Supports, Loads

# ---- group: Line to Beam (Karamba3D)
linetobeam = LineToBeamKaramba3D(Line=shatter_3, Identifier="B1", CrossSection=cross_section, New=True, Remove=toggle, LimitDistance_m=0.005)  # -> Element, Points, Info

linetobeam_2 = LineToBeamKaramba3D(Line=shatter_4, Identifier="C1", CrossSection=cross_section_2, New=True, Remove=toggle, LimitDistance_m=0.005)  # -> Element, Points, Info

# ----
python_2 = GhPythonScript(x=deform_2.DefModel)  # -> out, a; same code as python

# ---- group: Loads (Karamba3D)
loads_2 = LoadsKaramba3D(ForceVector=X, Local=False, PosInd=pt_2, LCase="1", mode="Point")

# ----
info_elem1d_2 = Info_Element_1D(Element_1D=draw_cs_3.Elem)  # -> Lines, Nodes, Sections, BetaAngle, Plane, Tags, IDs
assembly_3 = Assembly(Element_1Ds=elem1d_6, Supports=sup_5, Loads=flatten([pt_load_5, pt_load_6]))  # -> Model, Weight
panel_25 = Panel(ma.Result)
item_4 = ListItem(List=draw_cs_2.Mesh, Index=0, Wrap=True)
panel_26 = Panel(python_2.out)
info_elem1d_3 = Info_Element_1D(Element_1D=info_model_3.Element_1Ds)  # -> Lines, Nodes, Sections, BetaAngle, Plane, Tags, IDs
line_2 = Line(info_model_3.Lines)
info_sup_3 = Info_Support(Support=info_model_3.Supports)  # -> Points, Conditions
info_pload_2 = Info_PointLoad(Load=info_model_3.Loads)  # -> Points, ForceVector, MomentVector, LoadCase
facen = FaceNormals(Mesh=item_4)  # -> Centers, Normals
number_slider_11 = Slider(0, range=0..1)
solve_ls_3 = SolveLinearStatic(Model=assembly_3.Model)
amp = Amplitude(Vector=facen.Normals, Amplitude=Slider(0.1, range=0..0.1))
preview = CustomPreview(Geometry=[deform_2.Points, deform_2.Lines], Material=ColourSwatch(SwatchColor=RGB(255, 0, 0)))
number_slider_12 = Slider(0, range=0..100)

# ---- group: Assemble Model (Karamba3D)
assemble = AssembleModelKaramba3D(
    Elem=flatten([linetobeam_2.Element, linetobeam.Element]),
    Support=supp,
    Load=flatten([loads, loads_2]),
    LimitDistance_m=0.005)  # -> Model, Info, Mass_kg, CenterOfGravity

# ----
vdisex = VectorDisplayEx(Point=facen.Centers, Vector=amp, Colour=RGB(0, 0, 0), Width=2)
info_sec_4 = Info_Section(Section=info_elem1d_3.Sections)  # -> Material, Tag, Dimensions, Theta, StructuralProps, Curves
panel_27 = Panel(info_model_3.Nodes)
disassemble = DisassembleElementKaramba3D(Element=linetobeam_2.Element)  # -> Element, ElementIdentifier, AxisOfElement, CrossSection, Joints, Material, LocalCoordinateSystem, ElementIsActive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
info_node_2 = Info_Node(Node=info_elem1d_3.Nodes)  # -> Points, Id
info_model_4 = Info_Model(Model=solve_ls_3)  # -> Points, Lines, Nodes, Element_1Ds, Supports, Loads
deform_3 = Deformed_Shape(Model=solve_ls_3, LoadCase=number_slider_11, Factor=Slider(20, range=0..20))  # -> DefModel, Points, Lines, Points_2, Lines_2
number_slider_13 = Slider(5, range=0..10)
panel_28 = Panel("0")
info_mat_3 = Info_Material(Material=info_sec_4.Material)  # -> Tag, E, G, Gamma, Alpha, Fy
number_slider_14 = Slider(1, range=0..1)
panel_29 = Panel("""0
1""")

# ---- group: Analyze (Karamba3D)
analyze = AnalyzeKaramba3D(Model=assemble.Model)  # -> CalculatedModel, MaximumDisplacement_cm, ResultingForceOfGravity_kN, ElasticEnergy_kNm

# ----
b_forces = BeamForcesKaramba3D(
    AnalyzedModel=analyze.CalculatedModel,
    BeamIdentifiers=panel_18,
    LCase=panel_19,
    MaximumDistanceBetweenResults_m=-1,
    NumberOfResultsPerBeamElement=Slider(1, range=0..10))  # -> AnalyzedModel, NormalForce_kN, ShearForceVz_kN, ShearForceVy_kN, BendingMomentMt_kNm, simplify(BendingMomentMy_kNm), BendingMomentMz_kNm
panel_30 = Panel(b_forces.NormalForce_kN)
panel_31 = Panel(b_forces.BendingMomentMy_kNm)
info_pload_3 = Info_PointLoad(Load=info_model_4.Loads)  # -> Points, ForceVector, MomentVector, LoadCase
draw_cs_4 = Draw_CrossSection(Model=deform_3.DefModel)  # -> Elem, Mesh
reaction_2 = Reaction(Model=deform_2.DefModel, LoadCases=panel_29)  # -> Support, Points, FX, FY, FZ, MX, MY, MZ
reaction_3 = Reaction(Model=solve_ls_3, LoadCases=panel_29)  # -> Support, Points, FX, FY, FZ, MX, MY, MZ
branch = TreeBranch(Tree=b_forces.BendingMomentMy_kNm, Path=Slider(3, range=0..8), MaintainPaths=True)
e1d_forces_3 = Elem1D_Forces(Model=deform_3.DefModel, ElementTags="E1", LoadCases=number_slider_11)  # -> Elements, N, Vy, Vz, Mx, My, Mz
graph = QuickGraph(branch, SortOrder=0)
nodedisp = NodalDisplacementsKaramba3D(AnalyzedModel=analyze.CalculatedModel, ResultCase=0)  # -> AnalyzedModel, NodalTranslations_m, NodalRotations_rad
panel_32 = Panel(reaction_3.FY)
panel_33 = Panel(reaction_3.FX)
panel_34 = Panel(reaction_3.FZ)
panel_35 = Panel(reaction_2.FX)
panel_36 = Panel(reaction_2.FZ)

# ---- group: Model View (Karamba3D)
modelview = ModelViewKaramba3D(Model=analyze.CalculatedModel, ResultFactors=number_slider_10, ResultCase=number_slider_9)  # -> Model, DeformedMesh, DeformedAxes, DeformedModel

# ----
panel_38 = Panel(e1d_forces_3.N)
panel_39 = Panel(nodedisp.NodalTranslations_m)
crv = Curve(modelview.DeformedAxes)

# ---- group: Disassemble Model (Karamba3D)
disassemble_2 = DisassembleModelKaramba3D(Model=modelview.DeformedModel)  # -> Model, Point, Beam, Shell, Support, Load, Line, Mesh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

# ---- group: Beam View (Karamba3D)
beamview = BeamViewKaramba3D(Model=modelview.Model)  # -> Model, MeshesOfRenderedBeams, DeformedBeamAxes, LegendColors, LegendTags

# ----
pt_5 = Point(disassemble_2.Point)
